# Grasshopper definition centerline.gh (Grasshopper 1.0.8)
# Copyright: Arup
# plug-ins: eleFront5, Speckle.Connector.Grasshopper

speckle_model = SpeckleModel(
    Model="1d07df2656",
    Project="26839009fe",
    Server="https://app.speckle.systems",
    User="80EEB7BBE4744244BEF9F42A8D144D75",
    Workspace="f917653c12")
load = Load(SpeckleModel=speckle_model, AutoReceive=False)  # -> Collection, Properties
query_speckle_objects = QuerySpeckleObjects(Collection=load.Collection)
brep = Brep(query_speckle_objects)
integer = Integer(Slider(200, range=10..200))
blade_surface_brep = EleFrontDataDescription(brep, ShiftDepth=0, isNameSet=True)
no_planes_for_centerline_creation_int = EleFrontDataDescription(integer, ShiftDepth=0, isNameSet=True)
blade_surface_brep_2 = EleFrontDataDescription(blade_surface_brep, ShiftDepth=0, isNameSet=False)
bounding_box = BoundingBox(Content=blade_surface_brep, Plane=PlaneXY(0, 0, 0))  # -> Box, Box_2
deconstruct_brep = DeconstructBrep(Brep=bounding_box.Box)  # -> Faces, Edges, Vertices
list_item = ListItem(List=deconstruct_brep.Faces, Index=0, Wrap=True)  # -> Item2, Item1, Item
bottom_face_of_bbox_srf = EleFrontDataDescription(list_item.Item2, ShiftDepth=0, isNameSet=True)
top_face_of_bbox_srf = EleFrontDataDescription(list_item.Item1, ShiftDepth=0, isNameSet=True)
area = Area(Geometry=bottom_face_of_bbox_srf)  # -> Area, Centroid
area_2 = Area(Geometry=top_face_of_bbox_srf)  # -> Area, Centroid

bbox_centerline_shortening_bottom = Slider(-0.012, range=-0.1..-0.001)
bbox_centerline_shortening_top = Slider(-0.05, range=-0.25..-0.001)

line = Line(StartPoint=area.Centroid, EndPoint=area_2.Centroid)
no_planes_for_centerline_creation_int_2 = EleFrontDataDescription(no_planes_for_centerline_creation_int, ShiftDepth=0, isNameSet=False)
bbox_bottom_to_top_centerline_ln = EleFrontDataDescription(line, ShiftDepth=0, isNameSet=True)
extend_curve = ExtendCurve(
    Curve=bbox_bottom_to_top_centerline_ln,
    Type=0,
    Start=bbox_centerline_shortening_bottom,
    End=bbox_centerline_shortening_top)
pframes = PerpFrames(Curve=extend_curve, Count=no_planes_for_centerline_creation_int_2, Align=True)  # -> Frames, Parameters
plane = Plane(pframes.Frames)

# ---- group: Mesh | Plane is much faster than Brep | Plane
blade_surface_brep_3 = EleFrontDataDescription(blade_surface_brep_2, ShiftDepth=0, isNameSet=False)
mesh_brep = MeshBrep(
    Brep=blade_surface_brep_3,
    Settings={GridMaxCount=0, GridMinCount=16, JaggedSeams=False, MaxEdgeLength=0, MinEdgeLength=0.0001, MinTolerance=0, Refine=True, RefineAngle=0, RelativeTolerance=0.65, SimplePlanes=True, Tolerance=0})
mesh_plane = MeshPlane(Mesh=mesh_brep, Plane=plane)  # disabled

# ---- group: Visualize how much the BBox centerline should be shortened such that top and bottom sections are closed curves
blade_surface_msh = EleFrontDataDescription(mesh_brep, ShiftDepth=0, isNameSet=True)
list_item_2 = ListItem(List=plane, Index=0, Wrap=True)  # -> Item1, Item
merge = Merge(Data1=list_item_2.Item1, Data2=list_item_2.Item)
mesh_plane_2 = MeshPlane(Mesh=blade_surface_msh, Plane=merge)
area_3 = Area(Geometry=mesh_plane_2)  # -> Area, Centroid

# ----
discontinuity = Discontinuity(Curve=mesh_plane, Level=1)  # -> Points, Parameters
trim_tree = TrimTree(Tree=discontinuity.Points, Depth=1)
polyline = PolyLine(Vertices=trim_tree, Closed=Toggle(True))
area_4 = Area(Geometry=polyline)  # -> Area, Centroid
nurbs_curve = NurbsCurve(Vertices=flatten(area_4.Centroid), Degree=3, Periodic=False)  # -> Curve, Length, Domain
name_layer = Panel("centerline")
model_object = ModelObject(Geometry=nurbs_curve.Curve, Name=name_layer, Layer=name_layer)  # -> Object, Geometry, Name, Layer, Visibility, Display, Drafting, Render
content_cache = ContentCache(Content=model_object.Object)
