# Grasshopper definition longitudinal_sections.gh (Grasshopper 1.0.8)
# Copyright: Bedrock
# plug-ins: eleFront5, Speckle.Connector.Grasshopper

speckle_model = SpeckleModel(
    Model="6a13abf248",
    Project="26839009fe",
    Server="https://app.speckle.systems",
    User="80EEB7BBE4744244BEF9F42A8D144D75",
    Workspace="f917653c12")
load = Load(SpeckleModel=speckle_model, AutoReceive=False)  # -> Collection, Properties
no_transverse_sections_to_be_discarded_a = Slider(1, range=0..20)  # "No. transverse sections to be discarded at the top"
no_transverse_sections_to_be_discarded_a_2 = Slider(10, range=0..20)  # "No. transverse sections to be discarded at the bottom"
query_speckle_objects = QuerySpeckleObjects(Collection=load.Collection)
split_list = SplitList(List=query_speckle_objects, Index=no_transverse_sections_to_be_discarded_a)  # -> ListA, ListB
no_discarded_sections_bot_int = EleFrontDataDescription(no_transverse_sections_to_be_discarded_a_2, ShiftDepth=0, isNameSet=True)
discarded_sections_at_top = EleFrontDataDescription(split_list.ListA, ShiftDepth=0, isNameSet=True)
list_length = ListLength(List=split_list.ListB)
subtraction = Subtraction(A=list_length, B=no_discarded_sections_bot_int)
split_list_2 = SplitList(List=split_list.ListB, Index=subtraction)  # -> ListA, ListB
discarded_sections_at_bottom = EleFrontDataDescription(split_list_2.ListB, ShiftDepth=0, isNameSet=True)
discarded_sections_at_top_2 = EleFrontDataDescription(discarded_sections_at_top, ShiftDepth=0, isNameSet=False)
transverse_sections_sg = EleFrontDataDescription(split_list_2.ListA, ShiftDepth=0, isNameSet=True)
model_object = ModelObject(graft(transverse_sections_sg))
model_object_2 = ModelObject(model_object)
transverse_section_mo = EleFrontDataDescription(model_object_2, ShiftDepth=0, isNameSet=True)
transverse_section_mo_2 = EleFrontDataDescription(transverse_section_mo, ShiftDepth=0, isNameSet=True)
user_text = UserText(Content=transverse_section_mo, Keys="transverse_section_plane", UserTextMode=1)  # -> Content, Keys, Values
model_object_3 = ModelObject(transverse_section_mo)
transverse_section_mo_3 = EleFrontDataDescription(model_object_3, ShiftDepth=0, isNameSet=True)
string_to_plane = StringToPlane(string=user_text.Values)
plane = Plane(string_to_plane)
divide = DivideCurve(Curve=transverse_section_mo_3, Count=Slider(720, range=2..720), Kinks=False)  # -> Points, Tangents, Parameters
transverse_section_division_pts = EleFrontDataDescription(divide.Points, ShiftDepth=0, isNameSet=True)
transverse_section_pln = EleFrontDataDescription(plane, ShiftDepth=0, isNameSet=True)
# Why doesn't this work better
# when sorting the points in the CS
# of the Transverse Section planes?
transverse_section_division_pts_2 = EleFrontDataDescription(transverse_section_division_pts, ShiftDepth=0, isNameSet=True)
orient = Orient(Geometry=transverse_section_division_pts, Source=transverse_section_pln, Target=PlaneXY(0, 0, 0))  # -> Geometry, Transform
transverse_section_division_pts_3 = EleFrontDataDescription(transverse_section_division_pts, ShiftDepth=0, isNameSet=False)
pdecon = Deconstruct(Point=transverse_section_division_pts_2)  # -> XComponent, YComponent, ZComponent
pdecon_2 = Deconstruct(Point=transverse_section_division_pts_2)  # -> XComponent, YComponent, ZComponent
transverse_section_mo_4 = EleFrontDataDescription(transverse_section_mo_2, ShiftDepth=0, isNameSet=False)
sort = SortList(Keys=pdecon.YComponent, ValuesA=transverse_section_division_pts_3)  # -> Keys, ValuesA
sort_2 = SortList(Keys=pdecon_2.XComponent, ValuesA=transverse_section_division_pts_3)  # -> Keys, ValuesA
end = EndPoints(Curve=transverse_section_mo_4)  # -> flatten(Start), flatten(End)
item = ListItem(List=sort.ValuesA, Index=0, Wrap=True)  # -> flatten(Item1), flatten(Item)
item_2 = ListItem(List=sort_2.ValuesA, Index=0, Wrap=True)  # -> flatten(Item1), flatten(Item)
pline = PolyLine(Vertices=end.Start, Closed=False)
pline_2 = PolyLine(Vertices=item.Item1, Closed=False)
pline_3 = PolyLine(Vertices=item_2.Item1, Closed=False)
pline_4 = PolyLine(Vertices=item.Item, Closed=False)
high_pressure_edge_crv = EleFrontDataDescription(pline_4, ShiftDepth=0, isNameSet=True)
low_pressure_edge_crv = EleFrontDataDescription(pline_2, ShiftDepth=0, isNameSet=True)
leading_edge_crv = EleFrontDataDescription(pline_3, ShiftDepth=0, isNameSet=True)
trailing_edge_crv = EleFrontDataDescription(pline, ShiftDepth=0, isNameSet=True)
curve = Curve(trailing_edge_crv)
curve_2 = Curve(low_pressure_edge_crv)
curve_3 = Curve(high_pressure_edge_crv)
curve_4 = Curve(leading_edge_crv)
layer = Panel("longitudinal-sections")
merge = Merge(Data1=curve, Data2=curve_2, Data3=curve_3, Data4=curve_4)
names = Panel("""Trailing edge
Low pressure edge
High pressure edge
Leading edge""")
model_object_4 = ModelObject(Geometry=merge, Name=names, Layer=layer)  # -> Object, Geometry, Name, Layer, Visibility, Display, Drafting, Render
content_cache = ContentCache(Content=model_object_4.Object)
speckle_data_object = SpeckleDataObject(SpeckleDataObject=model_object_4.Object, HasApplicationIdParam=False)  # -> SpeckleDataObject, Geometries, Name, Properties, Path
create_collection = CreateCollection(LongitudinalSections=speckle_data_object.SpeckleDataObject, AlwaysInheritNames=False)
speckle_model_2 = SpeckleModel(
    Model="4b3ef982ae",
    Project="26839009fe",
    Server="https://app.speckle.systems",
    User="80EEB7BBE4744244BEF9F42A8D144D75",
    Workspace="f917653c12")
publish = Publish(SpeckleModel=speckle_model_2, Collection=create_collection)  # -> SpeckleModel, VersionID

# ==== cluster StringToPlane: Convert a formatted string that contains the definition of a plane ("O{x,y,z} X{x,y,z} Y{x,y,z}") to a Grasshopper plane.
string = ClusterInput()  # The definition of a plane's origin, x-axis and y-axis represented with a string: "O{x,y,z} X{x,y,z} Y{x,y,z}"
suirify = Suirify(string)
text = Text(suirify)
python_3_script = Python3Script(plane_as_str=text)  # -> origin, x_axis, y_axis; inputs plane_as_str: String
# ---------- python_3_script: Python ----------
"""Extract plane coordinates from a formatted string defining a plane's origin and x- & y-axes.

    The string defining a plane is formatted as:
    "O{x, y, z} X{x, y, z} Y{x, y, z}"

    Parameters:
    -----------
    plane_as_string : str
        String defining a plane's origin and x- & y-axes in the format "O{x, y, z} X{x, y, z} Y{x, y, z}"

    Returns:
    --------
    origin : str
        Coordinates of the plane origin as "{x, y, z}"
    x_axis : str
        Components of the unit vector defining the x-axis as "{x, y, z}"
    y_axis : str
        Components of the unit vector defining the y-axis as "{x, y, z}"
"""

import re

coords = re.split(r'(O|X|Y)', plane_as_str)
origin = coords[2].strip()
x_axis = coords[4].strip()
y_axis = coords[6].strip()
print(f"O{origin} X{x_axis} Y{y_axis}")
# ---------- end python_3_script ----------
point = Point(python_3_script.origin)
vector = Vector(python_3_script.x_axis)
vector_2 = Vector(python_3_script.y_axis)
construct_plane = ConstructPlane(Origin=point, XAxis=vector, YAxis=vector_2)
plane = Plane(construct_plane)
plane_2 = ClusterOutput(plane)  # Plane
