# Grasshopper definition transverse_sections.gh (Grasshopper 1.0.8)
# Copyright: Arup
# Copyright: Bedrock
# plug-ins: eleFront5, Speckle.Connector.Grasshopper

speckle_model = SpeckleModel(
    Model="1d07df2656",
    Project="26839009fe",
    Server="https://app.speckle.systems",
    User="80EEB7BBE4744244BEF9F42A8D144D75",
    Workspace="f917653c12")
speckle_model_2 = SpeckleModel(
    Model="8eec824161",
    Project="26839009fe",
    Server="https://app.speckle.systems",
    User="80EEB7BBE4744244BEF9F42A8D144D75",
    Workspace="f917653c12")
load = Load(SpeckleModel=speckle_model, AutoReceive=False)  # -> Collection, Properties
load_2 = Load(SpeckleModel=speckle_model_2, AutoReceive=False)  # -> Collection, Properties
no_segments = Slider(60, range=2..100)
query_speckle_objects = QuerySpeckleObjects(Collection=load.Collection)
query_speckle_objects_2 = QuerySpeckleObjects(Collection=load_2.Collection)
brep = Brep(query_speckle_objects)
curve = Curve(query_speckle_objects_2)
integer = Integer(no_segments)
no_transverse_sections_int = EleFrontDataDescription(integer, ShiftDepth=0, isNameSet=True)
blade_centerline_crv = EleFrontDataDescription(curve, ShiftDepth=0, isNameSet=True)
blade_surface_brep = EleFrontDataDescription(brep, ShiftDepth=0, isNameSet=True)
no_transverse_sections_int_2 = EleFrontDataDescription(no_transverse_sections_int, ShiftDepth=0, isNameSet=False)
blade_centerline_crv_2 = EleFrontDataDescription(blade_centerline_crv, ShiftDepth=0, isNameSet=True)
boolean_toggle = BooleanToggle(True)
perp_frames = PerpFrames(Curve=blade_centerline_crv_2, Count=no_transverse_sections_int_2, Align=True)  # -> Frames, Parameters
blade_surface_brep_2 = EleFrontDataDescription(blade_surface_brep, ShiftDepth=0, isNameSet=True)
plane = Plane(perp_frames.Frames)
flip_plane = FlipPlane(Plane=plane, ReverseX=boolean_toggle, ReverseY=boolean_toggle, SwapAxes=Toggle(False))
blade_surface_brep_3 = EleFrontDataDescription(blade_surface_brep_2, ShiftDepth=0, isNameSet=False)
plane_2 = Plane(graft(flip_plane))
brep_plane = BrepPlane(Brep=blade_surface_brep_3, Plane=plane_2)  # -> Curves, Points
section_planes_pln = EleFrontDataDescription(plane_2, ShiftDepth=0, isNameSet=True)
suirify = Suirify(brep_plane.Curves)
suirify_2 = Suirify(section_planes_pln)
project = Project(Geometry=suirify, Plane=suirify_2)  # -> Geometry, Transform
join_curves = JoinCurves(Curves=project.Geometry, Preserve=False)
simplify_curve = SimplifyCurve(Curve=join_curves)  # -> Curve, Simplified
suirify_3 = Suirify(simplify_curve.Curve)
transverse_sections_crv = EleFrontDataDescription(suirify_3, ShiftDepth=0, isNameSet=True)
section_planes_pln_2 = EleFrontDataDescription(suirify_2, ShiftDepth=0, isNameSet=True)
control_points = ControlPoints(Curve=transverse_sections_crv)  # -> Points, Weights, Knots
shift_paths = ShiftPaths(Data=control_points.Points, Offset=-1)
sort_along_curve = SortAlongCurve(Points=shift_paths, Curve=transverse_sections_crv)  # -> Points, Indices
polyline = PolyLine(Vertices=sort_along_curve.Points, Closed=Toggle(True))
simplify_curve_2 = SimplifyCurve(Curve=polyline)  # -> Curve, Simplified
control_points_2 = ControlPoints(Curve=simplify_curve_2.Curve)  # -> Points, Weights, Knots
nurbs_curve = NurbsCurve(Vertices=control_points_2.Points, Degree=3, Periodic=Toggle(True))  # -> Curve, Length, Domain
transverse_sections_crv_2 = EleFrontDataDescription(nurbs_curve.Curve, ShiftDepth=0, isNameSet=True)
section_planes_pln_3 = EleFrontDataDescription(section_planes_pln_2, ShiftDepth=0, isNameSet=False)
transverse_sections_crv_3 = EleFrontDataDescription(transverse_sections_crv_2, ShiftDepth=0, isNameSet=False)
section_planes_pln_4 = EleFrontDataDescription(section_planes_pln_3, ShiftDepth=0, isNameSet=True)
transverse_sections_crv_4 = EleFrontDataDescription(transverse_sections_crv_2, ShiftDepth=0, isNameSet=True)
transverse_sections_crv_5 = EleFrontDataDescription(transverse_sections_crv_3, ShiftDepth=0, isNameSet=True)
section_planes_pln_5 = EleFrontDataDescription(section_planes_pln_4, ShiftDepth=0, isNameSet=False)
transverse_sections_crv_6 = EleFrontDataDescription(transverse_sections_crv_4, ShiftDepth=0, isNameSet=True)
plane_3 = Plane(flatten(section_planes_pln_5))
section_planes_pln_6 = EleFrontDataDescription(section_planes_pln_5, ShiftDepth=0, isNameSet=False)
transverse_sections_crv_7 = EleFrontDataDescription(transverse_sections_crv_5, ShiftDepth=0, isNameSet=True)
list_length = ListLength(List=plane_3)
plane_to_string = PlaneToString(plane=section_planes_pln_6)
series = Series(Start="1", Step="1", Count=list_length)
no_transverse_sections_int_3 = EleFrontDataDescription(list_length, ShiftDepth=0, isNameSet=True)
section_planes_str = EleFrontDataDescription(plane_to_string, ShiftDepth=0, isNameSet=True)
transverse_sections_crv_8 = EleFrontDataDescription(transverse_sections_crv_6, ShiftDepth=0, isNameSet=False)
integer_2 = Integer(graft(series))
id_abbreviation_transvere_section = Panel("TS")
tree_statistics = TreeStatistics(Tree=transverse_sections_crv_8)  # -> Paths, Length, Count

# ---- group: Check & Viz whether any transverse sections aren't closed
transverse_sections_crv_9 = EleFrontDataDescription(transverse_sections_crv_4, ShiftDepth=0, isNameSet=True)
area = Area(Geometry=transverse_sections_crv_9)  # -> Area, Centroid
transverse_sections_crv_10 = EleFrontDataDescription(transverse_sections_crv_9, ShiftDepth=0, isNameSet=True)
null_item = NullItem(Item=area.Area)  # -> NullFlags, InvalidFlags, Description
is_not_a_closed_curve_bool = EleFrontDataDescription(null_item.NullFlags, ShiftDepth=0, isNameSet=True)
cull_pattern = CullPattern(List=tree_statistics.Paths, CullPattern=flatten(is_not_a_closed_curve_bool))
transverse_sections_crv_11 = EleFrontDataDescription(transverse_sections_crv_10, ShiftDepth=0, isNameSet=False)
tree_branch = TreeBranch(Tree=transverse_sections_crv_11, Path=cull_pattern, MaintainPaths=True)
transverse_sections_that_are_not_closed = EleFrontDataDescription(tree_branch, ShiftDepth=0, isNameSet=True)  # "Transverse sections that are not closed curves"

# ---- group: Check whether No. curves in a transverse section branch ≠ 1
transverse_sections_crv_12 = EleFrontDataDescription(transverse_sections_crv_4, ShiftDepth=0, isNameSet=True)
list_length_2 = ListLength(List=transverse_sections_crv_12)
transverse_sections_crv_13 = EleFrontDataDescription(transverse_sections_crv_12, ShiftDepth=0, isNameSet=True)
equality = Equality(FirstNumber=list_length_2, SecondNumber="1")  # -> Equality, Inequality
is_a_single_curve_bool = EleFrontDataDescription(equality.Inequality, ShiftDepth=0, isNameSet=True)
cull_pattern_2 = CullPattern(List=tree_statistics.Paths, CullPattern=flatten(is_a_single_curve_bool))
transverse_sections_crv_14 = EleFrontDataDescription(transverse_sections_crv_13, ShiftDepth=0, isNameSet=False)
tree_branch_2 = TreeBranch(Tree=transverse_sections_crv_14, Path=cull_pattern_2, MaintainPaths=True)
no_curves_in_transverse_section_branch_1 = EleFrontDataDescription(tree_branch_2, ShiftDepth=0, isNameSet=True)

# ----
transverse_section__int = EleFrontDataDescription(integer_2, ShiftDepth=0, isNameSet=True)
text = Text(section_planes_str)
no_transverse_sections_int_4 = EleFrontDataDescription(no_transverse_sections_int_3, ShiftDepth=0, isNameSet=False)
concatenate = Concatenate(FragmentA=id_abbreviation_transvere_section, FragmentB=transverse_section__int)
string_to_plane = StringToPlane(string=text)
plane_4 = Plane(string_to_plane)
transverse_secition_id_str = EleFrontDataDescription(concatenate, ShiftDepth=0, isNameSet=True)
transverse_sections_crv_15 = EleFrontDataDescription(transverse_sections_crv_7, ShiftDepth=0, isNameSet=False)
section_planes_str_2 = EleFrontDataDescription(section_planes_str, ShiftDepth=0, isNameSet=True)
no_transverse_sections_int_5 = EleFrontDataDescription(no_transverse_sections_int_4, ShiftDepth=0, isNameSet=False)
suirify_4 = Suirify(transverse_sections_crv_15)
suirify_5 = Suirify(transverse_secition_id_str)
suirify_6 = Suirify(section_planes_str_2)
panel = Panel("""transverse_section_id
transverse_section_plane""")
construct_domain = ConstructDomain(DomainStart="2", DomainEnd="400")
transverse_secition_id_str_2 = EleFrontDataDescription(suirify_5, ShiftDepth=0, isNameSet=True)
transverse_sections_crv_16 = EleFrontDataDescription(suirify_4, ShiftDepth=0, isNameSet=True)
merge = Merge(Data1=suirify_5, Data2=suirify_6)
subtraction = Subtraction(A=no_transverse_sections_int_5, B="1")
transverse_secition_id_str_3 = EleFrontDataDescription(transverse_secition_id_str_2, ShiftDepth=0, isNameSet=False)
range = Range(Domain=construct_domain, Steps=subtraction)  # -> reverse(Range)
user_text = UserText(Content=transverse_sections_crv_16, Keys=panel, Values=merge, UserTextMode=1)  # -> Content, Keys, Values
range_2 = Range(Domain=Domain(0, 1), Steps=subtraction)
colour_hsv = ColourHSV(Alpha=1, Hue=range_2, Saturation=1, Value=1)
model_object = ModelObject(user_text.Content)
print_attribute_source = Slider(1, range=0..3)
transverse_sections_crvobject = EleFrontDataDescription(model_object, ShiftDepth=0, isNameSet=True)
transverse_secition_id_str_4 = EleFrontDataDescription(transverse_secition_id_str_3, ShiftDepth=0, isNameSet=False)
colour = Colour(graft(colour_hsv))
# To ensure thicker lines are visible use command:
# PrintDisplay (State=On ...)
# 
# Optionally play with Scale=1
# but ideally you set that properly in the GH script
number = Number(graft(range))
display_colour = DisplayColour(Source=print_attribute_source, Colour=colour)  # -> DisplayColour, Source, Colour
print_colour = PrintColour(Source=print_attribute_source, Colour=colour)  # -> PrintColour, Source, Colour
print_width = PrintWidth(Source=print_attribute_source, Width=number)  # -> PrintWidth, Source, Width
drafting_attributes = DraftingAttributes(PrintColour=print_colour.PrintColour, PrintWidth=print_width.PrintWidth)  # -> Drafting, Linetype, LinetypeScale
transverse_sections_crvobject_2 = EleFrontDataDescription(transverse_sections_crvobject, ShiftDepth=0, isNameSet=False)
layer = Panel("transverse-sections")
transverse_secition_id_str_5 = EleFrontDataDescription(transverse_secition_id_str_4, ShiftDepth=0, isNameSet=False)
suirify_7 = Suirify(display_colour.DisplayColour)
suirify_8 = Suirify(drafting_attributes.Drafting)
model_object_2 = ModelObject(
    Object=transverse_sections_crvobject_2,
    Name=transverse_secition_id_str_5,
    Layer=layer,
    Display=suirify_7,
    Drafting=suirify_8)  # -> Object, Geometry, Name, Layer, Visibility, Display, Drafting, Render
content_cache = ContentCache(Content=model_object_2.Object)

# ==== cluster PlaneToString: Convert a Grasshopper plane to a formatted string that contains the definition of that plane: "O{x,y,z} X{x,y,z} Y{x,y,z}"
plane = ClusterInput()  # Plane
suirify = Suirify(plane)
plane_2 = Plane(suirify)
deconstruct_plane = DeconstructPlane(Plane=plane_2)  # -> Origin, XAxis, YAxis, ZAxis
concatenate = Concatenate(
    O="O",
    Origin_Pt=deconstruct_plane.Origin,
    X=" X",
    X_Axis_Vec=deconstruct_plane.XAxis,
    Y=" Y",
    Y_Axis_Vec=deconstruct_plane.YAxis)
text = Text(concatenate)
string = ClusterOutput(text)  # The definition of a plane's origin, x-axis and y-axis represented with a string: "O{x,y,z} X{x,y,z} Y{x,y,z}"

# ==== cluster StringToPlane: Convert a formatted string that contains the definition of a plane ("O{x,y,z} X{x,y,z} Y{x,y,z}") to a Grasshopper plane.
string = ClusterInput()  # The definition of a plane's origin, x-axis and y-axis represented with a string: "O{x,y,z} X{x,y,z} Y{x,y,z}"
suirify = Suirify(string)
text = Text(suirify)
python_3_script = Python3Script(plane_as_str=text)  # -> origin, x_axis, y_axis; inputs plane_as_str: String
# ---------- python_3_script: Python ----------
"""Extract plane coordinates from a formatted string defining a plane's origin and x- & y-axes.

    The string defining a plane is formatted as:
    "O{x, y, z} X{x, y, z} Y{x, y, z}"

    Parameters:
    -----------
    plane_as_string : str
        String defining a plane's origin and x- & y-axes in the format "O{x, y, z} X{x, y, z} Y{x, y, z}"

    Returns:
    --------
    origin : str
        Coordinates of the plane origin as "{x, y, z}"
    x_axis : str
        Components of the unit vector defining the x-axis as "{x, y, z}"
    y_axis : str
        Components of the unit vector defining the y-axis as "{x, y, z}"
"""

import re

coords = re.split(r'(O|X|Y)', plane_as_str)
origin = coords[2].strip()
x_axis = coords[4].strip()
y_axis = coords[6].strip()
print(f"O{origin} X{x_axis} Y{y_axis}")
# ---------- end python_3_script ----------
point = Point(python_3_script.origin)
vector = Vector(python_3_script.x_axis)
vector_2 = Vector(python_3_script.y_axis)
construct_plane = ConstructPlane(Origin=point, XAxis=vector, YAxis=vector_2)
plane = Plane(construct_plane)
plane_2 = ClusterOutput(plane)  # Plane
