# Grasshopper definition 3d_topo_laser_layers.gh (Grasshopper 1.0.8)
# plug-ins: eleFront5

query_directory = QueryDirectory(Directory="./data", Name="topo_layers_in_lasercs.3dm")  # -> graft(Directory), Directories, Files
value_list = ValueList({"ELEV_MAX", "ELEV_MIN", "ID", "polygon_id", "polyline_type"}, selected="polygon_id")
reference_by_layer = ReferenceByLayer(FilePath=query_directory.Files, LayerName="topo_layer_crvs", lightweight=False)
extended_geometry = ExtendedGeometry(flatten(reference_by_layer))
get_user_value = GetUserValue(Geometry=extended_geometry, Key=value_list)
text = Text(flatten(get_user_value))
create_set = CreateSet(List=text)  # -> Set, Map
filter_by_user_attributes = FilterByUserAttributes(Key=value_list, Val=create_set.Set, Attributes=extended_geometry, invertFilter=False)
value_list_2 = ValueList({"ELEV_MAX", "ELEV_MIN", "ID", "polygon_id", "polyline_type"}, selected="ELEV_MIN")
extended_geometry_2 = ExtendedGeometry(filter_by_user_attributes)
boundary_surfaces = BoundarySurfaces(Edges=extended_geometry_2)
list_item = ListItem(List=extended_geometry_2, Index=0, Wrap=True)
get_user_value_2 = GetUserValue(Geometry=extended_geometry_2, Key=value_list_2)
attach_attributes = AttachAttributes(Geometry=boundary_surfaces, Attributes=list_item)
value_list_3 = ValueList({"ELEV_MAX", "ELEV_MIN", "ID", "polygon_id", "polyline_type"}, selected="ELEV_MIN")
extended_geometry_3 = ExtendedGeometry(flatten(attach_attributes))
get_user_value_3 = GetUserValue(Geometry=extended_geometry_3, Key=value_list_3)
text_2 = Text(flatten(get_user_value_3))
create_set_2 = CreateSet(List=text_2)  # -> Set, Map
integer = Integer(create_set_2.Set)
sort_list = SortList(Keys=integer)  # -> Keys, ValuesValuesA
filter_by_user_attributes_2 = FilterByUserAttributes(Key=value_list_3, Val=sort_list.Keys, Attributes=extended_geometry_3, invertFilter=False)
extended_geometry_4 = ExtendedGeometry(filter_by_user_attributes_2)
extended_geometry_5 = ExtendedGeometry(filter_by_user_attributes_2)
tree_statistics = TreeStatistics(Tree=filter_by_user_attributes_2)  # -> Paths, Length, Count
tree_statistics_2 = TreeStatistics(Tree=extended_geometry_4)  # -> Paths, Length, Count
list_length = ListLength(List=tree_statistics.Paths)
wood_thickness = Slider(5, range=1..9)
list_item_2 = ListItem(List=tree_statistics_2.Paths, Index=Slider(0, range=0..13), Wrap=True)
series = Series(Start=0, Step=1, Count=list_length)
unit_z = UnitZ(Factor=wood_thickness)
number = Number(graft(series))
tree_branch = TreeBranch(Tree=extended_geometry_4, Path=list_item_2, MaintainPaths=True)
layer_surfaces_attrsrf = EleFrontDataDescription(extended_geometry_5, ShiftDepth=0, isNameSet=True)
value_list_4 = ValueList({"ELEV_MAX", "ELEV_MIN", "ID", "polygon_id", "polyline_type"}, selected="polygon_id")
multiplication = Multiplication(A=number, B=unit_z)
layer_surfaces_attrsrf_2 = EleFrontDataDescription(layer_surfaces_attrsrf, ShiftDepth=0, isNameSet=False)
move = Move(Geometry=layer_surfaces_attrsrf, Motion=multiplication)  # -> Geometry, Transform
get_all_keys_values = GetAllKeysValues(AttributesOrAttributedGeometry=layer_surfaces_attrsrf_2)  # -> Keys, Values, BakeName
get_user_value_4 = GetUserValue(Geometry=layer_surfaces_attrsrf_2, Key=value_list_4)
surface = Surface(move.Geometry)
query_model_materials = QueryModelMaterials(Name="Wood", AutoUpdateState=True)
extrude = Extrude(Base=surface, Direction=unit_z)
polygon_ids = EleFrontDataDescription(get_user_value_4, ShiftDepth=0, isNameSet=True)
render_material = RenderMaterial(Material=query_model_materials)  # -> ObjectMaterial, Source, Material
brep = Brep(graft(extrude))
polygon_ids_2 = EleFrontDataDescription(polygon_ids, ShiftDepth=0, isNameSet=False)
user_text = UserText(Content=brep, Keys=get_all_keys_values.Keys, Values=get_all_keys_values.Values, UserTextMode=1)  # -> Content, Keys, Values
model_layer = ModelLayer(Name="3d_topo_layers", Material=render_material.ObjectMaterial)  # -> Layer, Name, Hidden, Locked, DisplayColour, Material, Linetype
suirify = Suirify(user_text.Content)
suirify_2 = Suirify(polygon_ids_2)
model_object = ModelObject(Object=suirify, Name=suirify_2, Layer=model_layer.Layer)  # -> Object, Geometry, Name, Layer, Visibility, Display, Drafting, Render
content_cache = ContentCache(Content=model_object.Object)
