# Grasshopper definition bbox_rectangle_from_bounds_json.gh (Grasshopper 1.0.8)
# plug-ins: eleFront5

relative_path_from_gh_script_to_data_dir = Panel("./data")  # "Relative path from GH script to data directory"
file_name = Panel("epsg7415_bbox.json")
query_directory = QueryDirectory(Directory=relative_path_from_gh_script_to_data_dir, Name=file_name)  # -> graft(Directory), Directories, Files
file_path = FilePath(query_directory.Files)
read_file = ReadFile(File=file_path, PerLineParse=False)
attributesfromjson = AttributesFromJSON(JSONString=read_file)
value_list = ValueList({"max_east", "max_north", "min_east", "min_north"}, selected="min_east")
value_list_2 = ValueList({"max_east", "max_north", "min_east", "min_north"}, selected="max_east")
value_list_3 = ValueList({"max_east", "max_north", "min_east", "min_north"}, selected="min_north")
value_list_4 = ValueList({"max_east", "max_north", "min_east", "min_north"}, selected="max_north")
get_user_value = GetUserValue(Geometry=attributesfromjson, Key=value_list)
get_user_value_2 = GetUserValue(Geometry=attributesfromjson, Key=value_list_2)
get_user_value_3 = GetUserValue(Geometry=attributesfromjson, Key=value_list_3)
get_user_value_4 = GetUserValue(Geometry=attributesfromjson, Key=value_list_4)
construct_domain = ConstructDomain(DomainStart=get_user_value, DomainEnd=get_user_value_2)
construct_domain_2 = ConstructDomain(DomainStart=get_user_value_3, DomainEnd=get_user_value_4)
rectangle = Rectangle(Plane=PlaneXY(0, 0, 0), XSize=construct_domain, YSize=construct_domain_2, Radius=0)  # -> Rectangle, Length
rectangle_2 = Rectangle(flatten(rectangle.Rectangle))
bbox_rec = EleFrontDataDescription(rectangle_2, ShiftDepth=0, isNameSet=True)
model_object = ModelObject(Object=bbox_rec, Name="bbox", Layer="bbox")  # -> Object, Geometry, Name, Layer, Visibility, Display, Drafting, Render
content_cache = ContentCache(Content=model_object.Object)
