# Grasshopper definition crs_to_lasercs.gh (Grasshopper 1.0.8)
# plug-ins: eleFront5

query_directory = QueryDirectory(Directory="./data", Name="20m_topo_layer_polygon_crvs.3dm")  # -> graft(Directory), Directories, Files
reference_by_layer = ReferenceByLayer(FilePath=query_directory.Files, LayerName="manual_smooth_20m_topo_layers", lightweight=False)
geometry = Geometry(graft(reference_by_layer))
suirify = Suirify(geometry)
curve = Curve(flatten(geometry))
bounding_box = BoundingBox(Content=curve, Plane=PlaneXY(0, 0, 0), UnionBox=True)  # -> Box, Box_2
elevation_contour_polygons_attrcrv = EleFrontDataDescription(suirify, ShiftDepth=0, isNameSet=True)
construct_point = ConstructPoint(XCoordinate=0, YCoordinate=0, ZCoordinate=0)
box_corners = BoxCorners(Box=bounding_box.Box)  # -> CornerA, CornerB, CornerC, CornerD, CornerE, CornerF, CornerG, CornerH
bottom_right_pt = EleFrontDataDescription(box_corners.CornerB, ShiftDepth=0, isNameSet=True)
bottom_left_pt = EleFrontDataDescription(box_corners.CornerA, ShiftDepth=0, isNameSet=True)
top_right_pt = EleFrontDataDescription(box_corners.CornerC, ShiftDepth=0, isNameSet=True)
top_left_pt = EleFrontDataDescription(box_corners.CornerD, ShiftDepth=0, isNameSet=True)
_0_0_0__pt = EleFrontDataDescription(construct_point, ShiftDepth=0, isNameSet=True)
elevation_contour_polygons_attrcrv_2 = EleFrontDataDescription(elevation_contour_polygons_attrcrv, ShiftDepth=0, isNameSet=False)
vector_2pt = Vector2Pt(PointA=bottom_left_pt, PointB=_0_0_0__pt, Unitize=False)  # -> Vector, Length
move = Move(Geometry=elevation_contour_polygons_attrcrv_2, Motion=vector_2pt.Vector)  # -> Geometry, Transform
elevation_contour_polygons_attrcrv_3 = EleFrontDataDescription(elevation_contour_polygons_attrcrv_2, ShiftDepth=0, isNameSet=False)
elevation_contour_polygons_0_0_0_crv = EleFrontDataDescription(move.Geometry, ShiftDepth=0, isNameSet=True)
curve_2 = Curve(flatten(elevation_contour_polygons_0_0_0_crv))
bounding_box_2 = BoundingBox(Content=curve_2, Plane=PlaneXY(0, 0, 0), UnionBox=True)  # -> Box, Box_2
elevation_contour_polygons_0_0_0_crv_2 = EleFrontDataDescription(elevation_contour_polygons_0_0_0_crv, ShiftDepth=0, isNameSet=True)
box_corners_2 = BoxCorners(Box=bounding_box_2.Box)  # -> CornerA, CornerB, CornerC, CornerD, CornerE, CornerF, CornerG, CornerH
bottom_right_pt_2 = EleFrontDataDescription(box_corners_2.CornerB, ShiftDepth=0, isNameSet=True)
bottom_left_pt_2 = EleFrontDataDescription(box_corners_2.CornerA, ShiftDepth=0, isNameSet=True)
top_right_pt_2 = EleFrontDataDescription(box_corners_2.CornerC, ShiftDepth=0, isNameSet=True)
top_left_pt_2 = EleFrontDataDescription(box_corners_2.CornerD, ShiftDepth=0, isNameSet=True)
deconstruct = Deconstruct(Point=top_right_pt_2)  # -> XComponent, YComponent, ZComponent
x_size_of_laser_cutter_mm = Panel("900")
one_over_x = OneOverX(Value=deconstruct.XComponent)
elevation_contour_polygons_0_0_0_crv_3 = EleFrontDataDescription(elevation_contour_polygons_0_0_0_crv_2, ShiftDepth=0, isNameSet=False)
multiplication = Multiplication(A=one_over_x, B=x_size_of_laser_cutter_mm)
value_list = ValueList({"ELEV_MAX", "ELEV_MIN", "ID", "polygon_id", "polyline_type"}, selected="polygon_id")
elevation_contour_polygons_attrcrv_4 = EleFrontDataDescription(elevation_contour_polygons_attrcrv_3, ShiftDepth=0, isNameSet=False)
scale = Scale(Geometry=elevation_contour_polygons_0_0_0_crv_3, Center=Point(0, 0, 0), Factor=multiplication)  # -> Geometry, Transform
curve_3 = Curve(flatten(scale.Geometry))
get_user_value = GetUserValue(Geometry=elevation_contour_polygons_attrcrv_4, Key=value_list)
get_all_keys_values = GetAllKeysValues(AttributesOrAttributedGeometry=elevation_contour_polygons_attrcrv_4)  # -> Keys, Values, BakeName
bounding_box_3 = BoundingBox(Content=curve_3, Plane=PlaneXY(0, 0, 0), UnionBox=True)  # -> Box, Box_2
elevation_contour_polygons_in_laser_cutt = EleFrontDataDescription(scale.Geometry, ShiftDepth=0, isNameSet=True)  # "Elevation contour polygons in laser cutter CS_Crv"
box_corners_3 = BoxCorners(Box=bounding_box_3.Box)  # -> CornerA, CornerB, CornerC, CornerD, CornerE, CornerF, CornerG, CornerH
crv_names_str = EleFrontDataDescription(get_user_value, ShiftDepth=0, isNameSet=True)
bottom_right_pt_3 = EleFrontDataDescription(box_corners_3.CornerB, ShiftDepth=0, isNameSet=True)
bottom_left_pt_3 = EleFrontDataDescription(box_corners_3.CornerA, ShiftDepth=0, isNameSet=True)
top_right_pt_3 = EleFrontDataDescription(box_corners_3.CornerC, ShiftDepth=0, isNameSet=True)
top_left_pt_3 = EleFrontDataDescription(box_corners_3.CornerD, ShiftDepth=0, isNameSet=True)
curve_4 = Curve(elevation_contour_polygons_in_laser_cutt)
user_text = UserText(Content=curve_4, Keys=get_all_keys_values.Keys, Values=get_all_keys_values.Values, UserTextMode=1)  # -> Content, Keys, Values
crv_names_str_2 = EleFrontDataDescription(crv_names_str, ShiftDepth=0, isNameSet=False)
model_object = ModelObject(user_text.Content)
elevation_contour_polygons_in_laser_cutt_2 = EleFrontDataDescription(model_object, ShiftDepth=0, isNameSet=True)  # "Elevation contour polygons in laser cutter CS_MoCrv"
crv_names_str_3 = EleFrontDataDescription(crv_names_str_2, ShiftDepth=0, isNameSet=False)
model_object_2 = ModelObject(Object=elevation_contour_polygons_in_laser_cutt_2, Name=crv_names_str_3, Layer="topo_layer_crvs")  # -> Object, Geometry, Name, Layer, Visibility, Display, Drafting, Render
content_cache = ContentCache(Content=model_object_2.Object)
