# Grasshopper definition elevation_lines_from_topo_mesh.gh (Grasshopper 1.0.8)

query_directory = QueryDirectory(Directory="./data", Name="zuid_limburg_4m_topo_mesh.ply")  # -> graft(Directory), Directories, Files
import_content = ImportContent(FilePath=query_directory.Files)  # -> ModelTransform, Objects, Layers, Linetypes, HatchPatterns, AnnotationStyles, Materials, BlockDefinitions
mesh = Mesh(import_content.Objects)
multiplication = Multiplication(A=Slider(30, range=1..30), B=Slider(10, range=10..20))
construct_point = ConstructPoint(XCoordinate=0, YCoordinate=0, ZCoordinate=multiplication)
rectangle = Rectangle(Plane=PlaneXY(0, 0, 0), XSize="9000", YSize="6000", Radius=0)  # -> Rectangle, Length
xy_plane = XYPlane(Origin=construct_point)
bounding_box = BoundingBox(Content=mesh, Plane=PlaneXY(0, 0, 0))  # -> Box, Box_2
scale = Scale(Geometry=rectangle.Rectangle, Center=Point(0, 0, 0), Factor=Slider(0.95, range=0.8..1))  # -> Geometry, Transform
mesh_plane = MeshPlane(Mesh=mesh)
deconstruct_box = DeconstructBox(Box=bounding_box.Box)  # -> Plane, X, Y, Z
simplify_curve = SimplifyCurve()  # -> Curve, Simplified
curve = Curve([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])  # disabled
box_rectangle = BoxRectangle(Rectangle=scale.Geometry, Height="400")
smooth_polyline = SmoothPolyline(Strength=1, Times=1)
curve_2 = Curve([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])  # disabled
