# Grasshopper definition geojson_to_rhino.gh (Grasshopper 1.0.8)
# plug-ins: eleFront5

relative_path_from_gh_script_to_data_dir = Panel("./data")  # "Relative path from GH script to data directory"
file_name = Panel("20m_topo_layers.geojson")
query_directory = QueryDirectory(Directory=relative_path_from_gh_script_to_data_dir, Name=file_name)  # -> graft(Directory), Directories, Files
file_path = FilePath(query_directory.Files)
# Need to find a better way of handling the tree structure...
# Now not all branches have the same depth, i.e. No. indices in their path.
python_3_script = Python3Script(json_path=file_path, polygon_to_polylines=True)  # -> geometries, property_keys, property_values; inputs json_path: String, polygon_to_polylines: Boolean
# ---------- python_3_script: Python ----------
"""Convert a GeoJSON file to a Grasshopper data tree with Rhino geometries.

Each feature's geometry is converted to a branch in the output tree.
Multi-types and GeometryCollections create an extra branch level per sub-geometry.

Polygons can be returned as a list of closed polylines or as a trimmed
surface, i.e. planar Brep. The first polyline in the list is the exterior,
i.e. perimeter of the polygon. Subsequent polylines in the list are the
interiors, i.e. holes in the polygon. Returning list of closed polylines for
(multi-)polygona is default, because it's much quicker than returning a
trimmed surface.

Args:
    json_path: (str); GeoJSON file path; path to the .geojson or .json file to load
    polygon_to_polylines: (bool); Polygon to Polylines; if True, polygons are returned
        as a list of closed polylines; if False, a trimmed planar Brep is returned for each polygon.

Returns:
    geometries: (tree); Rhino geometry tree, one branch per feature (or sub-geometry)
    property_keys: (tree); feature property keys, one branch per feature
    property_values: (tree); feature property values, one branch per feature
"""

import json

import ghpythonlib.treehelpers as th
import Rhino.Geometry as rg


def _pt(c):
    return rg.Point3d(c[0], c[1], c[2] if len(c) > 2 else 0)


def _polygon_to_brep(coords):
    exterior_curve = rg.PolylineCurve([_pt(c) for c in coords[0]])
    breps = rg.Brep.CreatePlanarBreps([exterior_curve], 0.01)
    if not breps:
        return None
    brep = breps[0]
    for hole in coords[1:]:
        hole_curve = rg.PolylineCurve([_pt(c) for c in hole])
        hole_brep = rg.Brep.CreatePlanarBreps([hole_curve], 0.01)
        if hole_brep:
            diff = rg.Brep.CreateBooleanDifference([brep], hole_brep, 0.01)
            if diff:
                brep = diff[0]
    return brep


def _polygon_to_polylines(coords):
    return [rg.PolylineCurve([_pt(c) for c in ring]) for ring in coords]


def geojson_to_rhino_geometry(geom, polygon_to_polylines=True):
    """Convert a GeoJSON geometry to a list (or list of lists) of Rhino geometry.

    Single types (Point, LineString, Polygon) return a flat list with one item,
    placed in branch {i} of the output tree.

    Multi types (MultiPoint, MultiLineString, MultiPolygon) return a list of
    one-item lists, creating an extra branch level {i;j} per sub-geometry.

    When polygon_to_polylines is True, Polygon returns a list of closed polylines
    (one per ring) and MultiPolygon returns a list of such lists per sub-polygon.

    GeometryCollection returns a list of lists, one per contained geometry.
    """
    geom_type = geom["type"]

    if geom_type == "GeometryCollection":
        return [geojson_to_rhino_geometry(g, polygon_to_polylines) for g in geom["geometries"]]

    coords = geom["coordinates"]

    if geom_type == "Point":
        return [_pt(coords)]

    elif geom_type == "MultiPoint":
        return [[_pt(c)] for c in coords]

    elif geom_type == "LineString":
        return [rg.PolylineCurve([_pt(c) for c in coords])]

    elif geom_type == "MultiLineString":
        return [[rg.PolylineCurve([_pt(c) for c in line])] for line in coords]

    elif geom_type == "Polygon":
        if polygon_to_polylines:
            return _polygon_to_polylines(coords)
        return [_polygon_to_brep(coords)]

    elif geom_type == "MultiPolygon":
        if polygon_to_polylines:
            return [_polygon_to_polylines(poly_coords) for poly_coords in coords]
        return [[_polygon_to_brep(poly_coords)] for poly_coords in coords]

    else:
        return []


with open(json_path, "r") as f:
    geojson = json.load(f)

features = geojson["features"]

geometries = []
property_keys = []
property_values = []
for feat in features:
    geom = feat["geometry"]
    geometries.append(geojson_to_rhino_geometry(geom, polygon_to_polylines))

    properties = feat["properties"]
    property_keys.append(list(properties.keys()))
    property_values.append(list(properties.values()))

geometries = th.list_to_tree(geometries)
property_keys = th.list_to_tree(property_keys)
property_values = th.list_to_tree(property_values)
# ---------- end python_3_script ----------
geospatial_feature_geometries = EleFrontDataDescription(python_3_script.geometries, ShiftDepth=0, isNameSet=True)
property_values = EleFrontDataDescription(python_3_script.property_values, ShiftDepth=0, isNameSet=False)
property_keys = EleFrontDataDescription(python_3_script.property_keys, ShiftDepth=0, isNameSet=False)
curve = Curve(geospatial_feature_geometries)
elefront_attributes = EleFrontAttributes(Keys=property_keys, Values=property_values, maintainBakeName=False)  # -> Attributes, Keys, Values
elevation_contours_crv = EleFrontDataDescription(curve, ShiftDepth=0, isNameSet=True)
attributes = EleFrontDataDescription(elefront_attributes.Attributes, ShiftDepth=0, isNameSet=False)
keys = EleFrontDataDescription(elefront_attributes.Keys, ShiftDepth=0, isNameSet=False)
values = EleFrontDataDescription(elefront_attributes.Values, ShiftDepth=0, isNameSet=False)
suirify = Suirify(elevation_contours_crv)
suirify_2 = Suirify(attributes)
shiftmatch = ShiftMatch(GuideTree=suirify_2, SecondaryData1=suirify, shiftFromStart=False)  # -> GuideTree, SecondaryData1
elevation_contours_crv_2 = EleFrontDataDescription(suirify, ShiftDepth=0, isNameSet=True)
elevation_contours_crv_3 = EleFrontDataDescription(suirify, ShiftDepth=0, isNameSet=True)
elevation_contours_crv_4 = EleFrontDataDescription(elevation_contours_crv_3, ShiftDepth=0, isNameSet=True)
tree_statistics = TreeStatistics(Tree=elevation_contours_crv_3)  # -> Paths, Length, Count
list_length = ListLength(List=shiftmatch.SecondaryData1)
list_length_2 = ListLength(List=elevation_contours_crv_4)
data_path = DataPath(graft(tree_statistics.Paths))
match_tree = MatchTree(Tree=data_path, Guide=list_length_2)
elevation_contours_crv_5 = EleFrontDataDescription(elevation_contours_crv_2, ShiftDepth=0, isNameSet=True)
duplicate_data = DuplicateData(Data=shiftmatch.GuideTree, Number=list_length, Order=True)
duplicate_data_2 = DuplicateData(Data=match_tree, Number=list_length_2, Order=True)
unflatten_tree = UnflattenTree(Tree=duplicate_data, Guide=elevation_contours_crv_5)
value_list = ValueList({"ELEV_MAX", "ELEV_MIN", "ID"}, selected="ELEV_MIN")
match_tree_2 = MatchTree(Tree=duplicate_data_2, Guide=match_tree)
elevation_contours_crv_6 = EleFrontDataDescription(elevation_contours_crv_5, ShiftDepth=0, isNameSet=True)
polygon_crv_attr = EleFrontDataDescription(unflatten_tree, ShiftDepth=0, isNameSet=True)
polygon_path = EleFrontDataDescription(match_tree_2, ShiftDepth=0, isNameSet=True)
get_user_value = GetUserValue(Geometry=polygon_crv_attr, Key=value_list)
polygon_path_2 = EleFrontDataDescription(polygon_path, ShiftDepth=0, isNameSet=False)
round = Round(Number=get_user_value)  # -> Nearest, Floor, Ceiling
curve_2 = Curve(graft(elevation_contours_crv_6))
data = Data(graft(polygon_crv_attr))
data_path_2 = DataPath(graft(polygon_path_2))
suirify_3 = Suirify(round.Floor)
suirify_4 = Suirify(data_path_2)
concatenate = Concatenate(FragmentA=suirify_3, FragmentB="_", FragmentC=suirify_4)
elefront_attributes_2 = EleFrontAttributes(Attributes=data, Keys="polygon_id", Values=concatenate, maintainBakeName=False)  # -> Attributes, Keys, Values
elevation_contours_crv_7 = EleFrontDataDescription(curve_2, ShiftDepth=0, isNameSet=True)
attach_attributes = AttachAttributes(Geometry=elevation_contours_crv_7, Attributes=elefront_attributes_2.Attributes)
shift_paths = ShiftPaths(Data=attach_attributes, Offset=-1)
extended_geometry = ExtendedGeometry(shift_paths)
elevation_contours_attrcrv = EleFrontDataDescription(extended_geometry, ShiftDepth=0, isNameSet=True)
elevation_contours_attrcrv_2 = EleFrontDataDescription(elevation_contours_attrcrv, ShiftDepth=0, isNameSet=False)
polylines_for_idx_0_are_interior_polylin = Panel("1")  # "Polylines for idx > 0 are interior polylines, i.e. holes"
elevation_contours_attrcrv_3 = EleFrontDataDescription(elevation_contours_attrcrv_2, ShiftDepth=0, isNameSet=False)
split_list = SplitList(List=elevation_contours_attrcrv_2, Index=polylines_for_idx_0_are_interior_polylin)  # -> ListA, ListB
match_tree_3 = MatchTree(Tree=split_list.ListA, Guide=elevation_contours_attrcrv_3)
match_tree_4 = MatchTree(Tree=split_list.ListB, Guide=elevation_contours_attrcrv_3)
boolean_toggle = BooleanToggle(True)
extended_geometry_2 = ExtendedGeometry(match_tree_3)
extended_geometry_3 = ExtendedGeometry(match_tree_4)
suirify_5 = Suirify(elevation_contours_attrcrv_3)
suirify_6 = Suirify(extended_geometry_2)
suirify_7 = Suirify(extended_geometry_3)
polygon_exterior_attrcrv = EleFrontDataDescription(suirify_6, ShiftDepth=0, isNameSet=True)
clean_tree = CleanTree(RemoveNulls=boolean_toggle, RemoveInvalid=boolean_toggle, RemoveEmpty=boolean_toggle, Tree=suirify_7)
polygon_interior_attrcrv = EleFrontDataDescription(clean_tree, ShiftDepth=0, isNameSet=True)
elefront_attributes_3 = EleFrontAttributes(Attributes=polygon_exterior_attrcrv, Keys="polyline_type", Values="exterior", maintainBakeName=False)  # -> Attributes, Keys, Values
elefront_attributes_4 = EleFrontAttributes(Attributes=polygon_interior_attrcrv, Keys="polyline_type", Values="interior", maintainBakeName=False)  # -> Attributes, Keys, Values
polygon_exterior_attr = EleFrontDataDescription(elefront_attributes_3.Attributes, ShiftDepth=0, isNameSet=True)
polygon_interior_attr = EleFrontDataDescription(elefront_attributes_4.Attributes, ShiftDepth=0, isNameSet=True)
keys_2 = EleFrontDataDescription(elefront_attributes_3.Keys, ShiftDepth=0, isNameSet=False)
values_2 = EleFrontDataDescription(elefront_attributes_3.Values, ShiftDepth=0, isNameSet=False)
keys_3 = EleFrontDataDescription(elefront_attributes_4.Keys, ShiftDepth=0, isNameSet=False)
values_3 = EleFrontDataDescription(elefront_attributes_4.Values, ShiftDepth=0, isNameSet=False)
elevation_contours_attrcrv_4 = EleFrontDataDescription(suirify_5, ShiftDepth=0, isNameSet=True)
merge = Merge(Data1=polygon_exterior_attr, Data2=polygon_interior_attr)
attach_attributes_2 = AttachAttributes(Geometry=elevation_contours_attrcrv_4, Attributes=merge)
get_all_keys_values = GetAllKeysValues(AttributesOrAttributedGeometry=merge)  # -> Keys, Values, BakeName
value_list_2 = ValueList({"ELEV_MAX", "ELEV_MIN", "ID", "polygon_id", "polyline_type"}, selected="polygon_id")
extended_geometry_4 = ExtendedGeometry(graft(attach_attributes_2))
elevation_contours_attrcrv_5 = EleFrontDataDescription(extended_geometry_4, ShiftDepth=0, isNameSet=True)
user_text = UserText(Content=extended_geometry_4, Keys=get_all_keys_values.Keys, Values=get_all_keys_values.Values, UserTextMode=1)  # -> Content, Keys, Values
elevation_contours_mocrv = EleFrontDataDescription(user_text.Content, ShiftDepth=0, isNameSet=True)
get_user_value_2 = GetUserValue(Geometry=elevation_contours_attrcrv_5, Key=value_list_2)
value_list_3 = ValueList({"ELEV_MAX", "ELEV_MIN", "ID", "polygon_id", "polyline_type"}, selected="ELEV_MIN")
value_list_4 = ValueList({"10.738281", "100", "120", "140", "160", "180", "200", "220", "240", "260", "280", "300", "40", "60", "80"}, selected="10.738281")
elevation_contours_attrcrv_6 = EleFrontDataDescription(flatten(elevation_contours_attrcrv_5), ShiftDepth=0, isNameSet=True)
model_object = ModelObject(Object=elevation_contours_mocrv, Name=get_user_value_2, Layer="20m_topo_layers")  # -> Object, Geometry, Name, Layer, Visibility, Display, Drafting, Render
value_list_5 = ValueList({"ELEV_MAX", "ELEV_MIN", "ID", "polygon_id", "polyline_type"}, selected="polyline_type")
filter_by_user_attributes = FilterByUserAttributes(Key=value_list_3, Val=value_list_4, Attributes=elevation_contours_attrcrv_6, invertFilter=False)
content_cache = ContentCache(Content=model_object.Object)
get_user_value_3 = GetUserValue(Geometry=filter_by_user_attributes, Key=value_list_5)
