# Grasshopper definition laserbeest_drawings.gh (Grasshopper 1.0.8)
# plug-ins: eleFront5

query_directory = QueryDirectory(Directory="./data", Name="topo_layers_in_lasercs.3dm")  # -> graft(Directory), Directories, Files
value_list = ValueList({"ELEV_MAX", "ELEV_MIN", "ID", "polygon_id", "polyline_type"}, selected="ELEV_MIN")
reference_by_layer = ReferenceByLayer(FilePath=query_directory.Files, LayerName="topo_layer_crvs", lightweight=False)
extended_geometry = ExtendedGeometry(flatten(reference_by_layer))
get_user_value = GetUserValue(Geometry=extended_geometry, Key=value_list)
text = Text(flatten(get_user_value))
create_set = CreateSet(List=text)  # -> Set, Map
integer = Integer(create_set.Set)
sort_list = SortList(Keys=integer)  # -> Keys, ValuesValuesA
filter_by_user_attributes = FilterByUserAttributes(Key=value_list, Val=sort_list.Keys, Attributes=extended_geometry, invertFilter=False)
curve = Curve(<curve referenced from the Rhino model>)
suirify = Suirify(filter_by_user_attributes)
curve_2 = Curve(graft(suirify))
bbox_rec = EleFrontDataDescription(curve, ShiftDepth=0, isNameSet=True)
extended_geometry_2 = ExtendedGeometry(suirify)
curve_3 = Curve(curve_2)
curve_curve = CurveCurve(CurveA=curve_2, CurveB=bbox_rec)  # -> Points, ParamsA, ParamsB
crv = EleFrontDataDescription(curve_3, ShiftDepth=0, isNameSet=True)
contours_attrcrv = EleFrontDataDescription(extended_geometry_2, ShiftDepth=0, isNameSet=True)
list_item = ListItem(List=curve_curve.Points, Index=0, Wrap=True)
shatter = Shatter(Curve=crv, Parameters=curve_curve.ParamsA)
suirify_2 = Suirify(list_item)
suirify_3 = Suirify(crv)
suirify_4 = Suirify(shatter)
tree_statistics = TreeStatistics(Tree=suirify_2)  # -> Paths, Length, Count
null_item = NullItem(Item=suirify_2)  # -> NullFlags, InvalidFlags, Description
discontinuity = Discontinuity(Curve=suirify_4, Level=1)  # -> Points, Parameters
polylines_split_on_the_border = EleFrontDataDescription(suirify_4, ShiftDepth=0, isNameSet=True)
boolean = Boolean(flatten(null_item.NullFlags))
data_path = DataPath(tree_statistics.Paths)
list_length = ListLength(List=discontinuity.Points)
cull_pattern = CullPattern(List=data_path, CullPattern=boolean)
larger_than = LargerThan(FirstNumber=list_length, SecondNumber=Slider(4, range=1..4))  # -> LargerThan, OrEqualTo
polylines_split_on_the_border_2 = EleFrontDataDescription(polylines_split_on_the_border, ShiftDepth=0, isNameSet=False)
tree_branch = TreeBranch(Tree=suirify_3, Path=cull_pattern, MaintainPaths=True)
shiftmatch = ShiftMatch(GuideTree=polylines_split_on_the_border_2, SecondaryData1=larger_than.LargerThan, shiftFromStart=False)  # -> GuideTree, SecondaryData1
polylines_that_don_t_touch_the_border = EleFrontDataDescription(tree_branch, ShiftDepth=0, isNameSet=True)
polylines_split_on_the_border_3 = EleFrontDataDescription(polylines_split_on_the_border_2, ShiftDepth=0, isNameSet=False)
boolean_2 = Boolean(invert(shiftmatch.SecondaryData1))
cull_pattern_2 = CullPattern(List=polylines_split_on_the_border_3, CullPattern=shiftmatch.SecondaryData1)
cull_pattern_3 = CullPattern(List=polylines_split_on_the_border_3, CullPattern=boolean_2)
polylines_that_don_t_touch_the_border_2 = EleFrontDataDescription(polylines_that_don_t_touch_the_border, ShiftDepth=0, isNameSet=False)
polylines_not_the_border = EleFrontDataDescription(cull_pattern_2, ShiftDepth=0, isNameSet=True)
border_polylines = EleFrontDataDescription(cull_pattern_3, ShiftDepth=0, isNameSet=True)
contours_attrcrv_2 = EleFrontDataDescription(contours_attrcrv, ShiftDepth=0, isNameSet=False)
merge = Merge(Data1=polylines_that_don_t_touch_the_border_2, Data2=polylines_not_the_border)
shift_paths = ShiftPaths(Data=merge, Offset=-1)
extended_geometry_3 = ExtendedGeometry(graft(contours_attrcrv_2))
list_length_2 = ListLength(List=merge)
extended_geometry_4 = ExtendedGeometry(shift_paths)
duplicate_data = DuplicateData(Data=extended_geometry_3, Number=list_length_2, Order=True)
tree_statistics_2 = TreeStatistics(Tree=extended_geometry_4)  # -> Paths, Length, Count
shiftmatch_2 = ShiftMatch(GuideTree=extended_geometry_4, SecondaryData1=duplicate_data, shiftFromStart=False)  # -> GuideTree, SecondaryData1
list_length_3 = ListLength(List=tree_statistics_2.Paths)
data_path_2 = DataPath(tree_statistics_2.Paths)
unit_x = UnitX(Factor="1000")
series = Series(Start=0, Step=1, Count=list_length_3)
contours_attrcrv_3 = EleFrontDataDescription(shiftmatch_2.SecondaryData1, ShiftDepth=0, isNameSet=True)
number = Number(graft(series))
multiplication = Multiplication(A=number, B=unit_x)
cull_index = CullIndex(List=data_path_2, Indices="0", Wrap=True)
value_list_2 = ValueList({"ELEV_MAX", "ELEV_MIN", "ID", "polygon_id", "polyline_type"}, selected="polygon_id")
suirify_5 = Suirify(extended_geometry_4)
suirify_6 = Suirify(multiplication)

# ---- group: Duplicate WERKSTUKKEN
panel = Panel("""04_WERKSTUK
05_OPMERKINGEN""")
query_model_objects = QueryModelObjects(Layer=panel, Locked=True, Hidden=True, AutoUpdateState=True)  # disabled
model_object = ModelObject(flatten(query_model_objects))
model_object_2 = EleFrontDataDescription(model_object, ShiftDepth=0, isNameSet=False)
move = Move(Geometry=model_object_2, Motion=suirify_6)  # -> Geometry, Transform
model_object_3 = ModelObject(Object=model_object_2, Geometry=move.Geometry)  # -> Object, Geometry, Name, Layer, Visibility, Display, Drafting, Render
content_cache = ContentCache(Content=model_object_3.Object, Action=2)

# ----
contours_attrcrv_4 = EleFrontDataDescription(contours_attrcrv_3, ShiftDepth=0, isNameSet=True)
tree_branch_2 = TreeBranch(Tree=suirify_5, Path=cull_index, MaintainPaths=True)
transform = Transform(suirify_6)
get_all_keys_values = GetAllKeysValues(AttributesOrAttributedGeometry=contours_attrcrv_4)  # -> Keys, Values, BakeName
contours_attrcrv_5 = EleFrontDataDescription(contours_attrcrv_4, ShiftDepth=0, isNameSet=False)
move_2 = Move(Geometry=tree_branch_2, Motion=transform)  # -> Geometry, Transform
move_3 = Move(Geometry=suirify_5, Motion=transform)  # -> Geometry, Transform
get_user_value_2 = GetUserValue(Geometry=contours_attrcrv_5, Key=value_list_2)
curve_4 = Curve(graft(move_3.Geometry))
curve_5 = Curve(graft(move_2.Geometry))
user_text = UserText(Content=curve_4, Keys=get_all_keys_values.Keys, Values=get_all_keys_values.Values, UserTextMode=1)  # -> Content, Keys, Values
contour_names = EleFrontDataDescription(get_user_value_2, ShiftDepth=0, isNameSet=True)
model_object_4 = ModelObject(Object=user_text.Content, Name=contour_names, Layer="01_SNIJLIJNEN")  # -> Object, Geometry, Name, Layer, Visibility, Display, Drafting, Render
model_object_5 = ModelObject(Geometry=curve_5, Layer="02_GRAVEERLIJNEN")  # -> Object, Geometry, Name, Layer, Visibility, Display, Drafting, Render
merge_2 = Merge(Data1=model_object_4.Object, Data2=model_object_5.Object)
content_cache_2 = ContentCache(Content=merge_2)
