# Grasshopper definition smooth_contour_polygons.gh (Grasshopper 1.0.8)
# plug-ins: eleFront5

query_model_objects = QueryModelObjects(Layer="20m_topo_layers", Locked=True, Hidden=True, AutoUpdateState=True)
query_model_objects_2 = QueryModelObjects(Layer="manual_20m_topo_layers", Locked=True, Hidden=True, AutoUpdateState=True)
query_model_objects_3 = QueryModelObjects(Name="bbox", Locked=True, Hidden=True, AutoUpdateState=True)
model_object = ModelObject(query_model_objects)
curve = Curve(query_model_objects)
model_object_2 = ModelObject(query_model_objects_2)
rectangle = Rectangle(query_model_objects_3)
model_object_3 = ModelObject(query_model_objects)
simplify_curve = SimplifyCurve(Curve=curve)  # -> Curve, Simplified; disabled
bbox_rec = EleFrontDataDescription(rectangle, ShiftDepth=0, isNameSet=True)
user_text = UserText(Content=model_object_2, UserTextMode=1)  # -> Content, Keys, Values
elevation_contour_polygons_mocrv = EleFrontDataDescription(model_object, ShiftDepth=0, isNameSet=True)
elevation_contour_polygons_mocrv_2 = EleFrontDataDescription(model_object_2, ShiftDepth=0, isNameSet=True)
user_text_2 = UserText(Content=model_object, UserTextMode=1)  # -> Content, Keys, Values
curve_2 = Curve(graft(user_text.Content))
elefront_attributes = EleFrontAttributes(Keys=user_text.Keys, Values=user_text.Values, maintainBakeName=False)  # -> Attributes, Keys, Values
curve_3 = Curve([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])
model_object_4 = ModelObject(graft(user_text_2.Content))
elefront_attributes_2 = EleFrontAttributes(Keys=user_text_2.Keys, Values=user_text_2.Values, maintainBakeName=False)  # -> Attributes, Keys, Values
model_object_5 = ModelObject(Object=elevation_contour_polygons_mocrv, Geometry=curve_3, Layer="simple_20m_topo_layers")  # -> Object, Geometry, Name, Layer, Visibility, Display, Drafting, Render
attach_attributes = AttachAttributes(Geometry=curve_2, Attributes=elefront_attributes.Attributes)
keys = EleFrontDataDescription(elefront_attributes.Keys, ShiftDepth=0, isNameSet=False)
values = EleFrontDataDescription(elefront_attributes.Values, ShiftDepth=0, isNameSet=False)
value_list = ValueList({"ELEV_MAX", "ELEV_MIN", "ID", "polygon_id", "polyline_type"}, selected="polygon_id")
bake_name = EleFrontDataDescription("simple_20m_topo_layers", ShiftDepth=0, isNameSet=True)
attributes = EleFrontDataDescription(elefront_attributes_2.Attributes, ShiftDepth=0, isNameSet=False)
keys_2 = EleFrontDataDescription(elefront_attributes_2.Keys, ShiftDepth=0, isNameSet=False)
values_2 = EleFrontDataDescription(elefront_attributes_2.Values, ShiftDepth=0, isNameSet=False)
value_list_2 = ValueList({"ELEV_MAX", "ELEV_MIN", "ID", "polygon_id", "polyline_type"}, selected="polygon_id")
value_list_3 = ValueList({"10_{0}", "100_{4;0}", "100_{4;1}", "100_{4;10}", "100_{4;11}", "100_{4;12}", "100_{4;13}", "100_{4;14}", "100_{4;15}", "100_{4;2}"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}, selected="80_{3;9}")
attach_attributes_2 = AttachAttributes(Geometry=model_object_4, Attributes=attributes)
extended_geometry = ExtendedGeometry(flatten(attach_attributes))
content_cache = ContentCache(Name=bake_name, Content=model_object_5.Object, Action=2)
get_user_value = GetUserValue(Geometry=extended_geometry, Key=value_list)
filter_by_user_attributes = FilterByUserAttributes(Key=value_list_2, Val=value_list_3, Attributes=attach_attributes_2, invertFilter=False)
text = Text(flatten(get_user_value))
create_set = CreateSet(List=text)  # -> Set, Map
get_all_keys_values = GetAllKeysValues(AttributesOrAttributedGeometry=filter_by_user_attributes)  # -> flatten(Keys), flatten(Values), BakeName
filter_by_user_attributes_2 = FilterByUserAttributes(Key=value_list, Val=create_set.Set, Attributes=extended_geometry, invertFilter=False)
extended_geometry_2 = ExtendedGeometry(graft(filter_by_user_attributes_2))
curve_4 = Curve(graft(filter_by_user_attributes_2))
panel = Panel(get_all_keys_values.Keys)
panel_2 = Panel(get_all_keys_values.Values)
bbox_rec_2 = EleFrontDataDescription(bbox_rec, ShiftDepth=0, isNameSet=False)
elevation_contour_polygons_attrcrv = EleFrontDataDescription(extended_geometry_2, ShiftDepth=0, isNameSet=True)
curve_5 = Curve(curve_4)
curve_curve = CurveCurve(CurveA=curve_4, CurveB=bbox_rec_2)  # -> Points, ParamsA, ParamsB
crv = EleFrontDataDescription(curve_5, ShiftDepth=0, isNameSet=True)
list_item = ListItem(List=curve_curve.Points, Index=0, Wrap=True)
shatter = Shatter(Curve=crv, Parameters=curve_curve.ParamsA)
suirify = Suirify(list_item)
suirify_2 = Suirify(crv)
suirify_3 = Suirify(shatter)
tree_statistics = TreeStatistics(Tree=suirify)  # -> Paths, Length, Count
null_item = NullItem(Item=suirify)  # -> NullFlags, InvalidFlags, Description
discontinuity = Discontinuity(Curve=suirify_3, Level=1)  # -> Points, Parameters
polylines_split_on_the_border = EleFrontDataDescription(suirify_3, ShiftDepth=0, isNameSet=True)
boolean = Boolean(flatten(null_item.NullFlags))
data_path = DataPath(tree_statistics.Paths)
list_length = ListLength(List=discontinuity.Points)
cull_pattern = CullPattern(List=data_path, CullPattern=boolean)
larger_than = LargerThan(FirstNumber=list_length, SecondNumber=Slider(4, range=1..4))  # -> LargerThan, OrEqualTo
polylines_split_on_the_border_2 = EleFrontDataDescription(polylines_split_on_the_border, ShiftDepth=0, isNameSet=False)
tree_branch = TreeBranch(Tree=suirify_2, Path=cull_pattern, MaintainPaths=True)
shiftmatch = ShiftMatch(GuideTree=polylines_split_on_the_border_2, SecondaryData1=larger_than.LargerThan, shiftFromStart=False)  # -> GuideTree, SecondaryData1
polylines_that_don_t_touch_the_border = EleFrontDataDescription(tree_branch, ShiftDepth=0, isNameSet=True)
polylines_split_on_the_border_3 = EleFrontDataDescription(polylines_split_on_the_border_2, ShiftDepth=0, isNameSet=False)
boolean_2 = Boolean(invert(shiftmatch.SecondaryData1))
cull_pattern_2 = CullPattern(List=polylines_split_on_the_border_3, CullPattern=shiftmatch.SecondaryData1)
cull_pattern_3 = CullPattern(List=polylines_split_on_the_border_3, CullPattern=boolean_2)
polylines_that_don_t_touch_the_border_2 = EleFrontDataDescription(polylines_that_don_t_touch_the_border, ShiftDepth=0, isNameSet=False)
polylines_not_the_border = EleFrontDataDescription(cull_pattern_2, ShiftDepth=0, isNameSet=True)
border_polylines = EleFrontDataDescription(cull_pattern_3, ShiftDepth=0, isNameSet=True)
merge = Merge(Data1=polylines_that_don_t_touch_the_border_2, Data2=polylines_not_the_border)
reduce = Reduce(Polyline=merge, Tolerance=Slider(6, range=1..20))  # -> Polyline, Reduction
smooth_polyline = SmoothPolyline(Polyline=reduce.Polyline, Strength=1, Times=Slider(10, range=1..10))
simplify_curve_2 = SimplifyCurve(Curve=smooth_polyline)  # -> Curve, Simplified
reduce_2 = Reduce(Polyline=simplify_curve_2.Curve, Tolerance=Slider(5, range=1..20))  # -> Polyline, Reduction
smooth_polyline_2 = SmoothPolyline(Polyline=reduce_2.Polyline, Strength=1, Times=Slider(10, range=1..10))
border_polylines_2 = EleFrontDataDescription(border_polylines, ShiftDepth=0, isNameSet=False)
elevation_contour_polygons_attrcrv_2 = EleFrontDataDescription(elevation_contour_polygons_attrcrv, ShiftDepth=0, isNameSet=False)
merge_2 = Merge(Data1=smooth_polyline_2, Data2=border_polylines_2)
value_list_4 = ValueList({"ELEV_MAX", "ELEV_MIN", "ID", "polygon_id", "polyline_type"}, selected="polygon_id")
join_curves = JoinCurves(Curves=merge_2, Preserve=False)
get_all_keys_values_2 = GetAllKeysValues(AttributesOrAttributedGeometry=elevation_contour_polygons_attrcrv_2)  # -> Keys, Values, BakeName
smooth_elevation_contour_polygons_crv = EleFrontDataDescription(join_curves, ShiftDepth=0, isNameSet=True)
get_user_value_2 = GetUserValue(Geometry=elevation_contour_polygons_attrcrv_2, Key=value_list_4)
user_text_3 = UserText(
    Content=smooth_elevation_contour_polygons_crv,
    Keys=get_all_keys_values_2.Keys,
    Values=get_all_keys_values_2.Values,
    UserTextMode=1)  # -> Content, Keys, Values
text_2 = Text(get_user_value_2)
suirify_4 = Suirify(user_text_3.Content)
suirify_5 = Suirify(text_2)
model_object_6 = ModelObject(Object=suirify_4, Name=suirify_5, Layer="smooth_20m_topo_layers")  # -> Object, Geometry, Name, Layer, Visibility, Display, Drafting, Render
bake_name_2 = EleFrontDataDescription("smooth_20m_topo_layers", ShiftDepth=0, isNameSet=True)
content_cache_2 = ContentCache(Name=bake_name_2, Content=model_object_6.Object, Action=1)
