# Grasshopper definition topo_mesh_from_geotif_heron.gh (Grasshopper 1.0.8)
# plug-ins: Heron, eleFront5

wgs_84_world_geodetic_system_1984 = Panel("EPSG:4326")
wgs_84_spherical_web_mercator = Panel("EPSG:3857")
dutch_compound_crs_rd_new_nap_height = Panel("EPSG:7415")
panel = Panel("""min_easting
min_northing
max_easting
max_northing""")
panel_2 = Panel("""171090
306710
205970
333450""")
file_name_pattern = Panel("*4m_dem.tif")
cwd = Panel("./")
query_directory = QueryDirectory(Directory=cwd, Name=file_name_pattern)  # -> graft(Directory), Directories, Files
value_list = ValueList({"max_easting", "max_northing", "min_easting", "min_northing"}, selected="min_easting")
value_list_2 = ValueList({"max_easting", "max_northing", "min_easting", "min_northing"}, selected="max_easting")
elefront_attributes = EleFrontAttributes(Keys=panel, Values=panel_2, maintainBakeName=False)  # -> Attributes, Keys, Values
value_list_3 = ValueList({"max_easting", "max_northing", "min_easting", "min_northing"}, selected="min_northing")
value_list_4 = ValueList({"max_easting", "max_northing", "min_easting", "min_northing"}, selected="max_northing")
set_spatial_reference_system = SetSpatialReferenceSystem(SRS=dutch_compound_crs_rd_new_nap_height, Update=Button())
coordinate_transformation = CoordinateTransformation(SourceSRS="WGS84", DestinationSRS=dutch_compound_crs_rd_new_nap_height)
attributes = EleFrontDataDescription(elefront_attributes.Attributes, ShiftDepth=0, isNameSet=False)
keys = EleFrontDataDescription(elefront_attributes.Keys, ShiftDepth=0, isNameSet=False)
values = EleFrontDataDescription(elefront_attributes.Values, ShiftDepth=0, isNameSet=False)
get_user_value = GetUserValue(Geometry=attributes, Key=value_list)
get_user_value_2 = GetUserValue(Geometry=attributes, Key=value_list_2)
get_user_value_3 = GetUserValue(Geometry=attributes, Key=value_list_3)
get_user_value_4 = GetUserValue(Geometry=attributes, Key=value_list_4)
construct_domain = ConstructDomain(DomainStart=get_user_value, DomainEnd=get_user_value_2)
construct_domain_2 = ConstructDomain(DomainStart=get_user_value_3, DomainEnd=get_user_value_4)
rectangle = Rectangle(Plane=PlaneXY(0, 0, 0), XSize=construct_domain, YSize=construct_domain_2, Radius=0)  # -> Rectangle, Length
curve = Curve(rectangle.Rectangle)
offset_curve_loose = OffsetCurveLoose(Curve=curve, Distance=Slider(-10, range=-20..20))
import_topo = ImportTopo(Boundary=offset_curve_loose, TopographyRasterFile=query_directory.Files, Clip=True, FillNoData=False)  # -> TopographyMesh, TopographyExtent, TopographySourceInfo
discontinuity = Discontinuity(Curve=curve, Level=1)  # -> Points, Parameters
curve_2 = Curve(import_topo.TopographyExtent)
mesh = Mesh(import_topo.TopographyMesh)
panel_3 = Panel(import_topo.TopographySourceInfo)
content_cache = ContentCache(Content=mesh)
discontinuity_2 = Discontinuity(Curve=offset_curve_loose, Level=1)  # -> Points, Parameters
bounding_box = BoundingBox(Content=mesh, Plane=PlaneXY(0, 0, 0))  # -> Box, Box_2
